# Grasshopper definition randomwaves.gh (Grasshopper 1.0.4)
# plug-ins: Python Interpreter

xy = XYPlane(Origin=Point(0, 0, 0))
num = Number(0.785398)
rotate = Rotate(Angle=num, Plane=xy)  # -> Geometry, Transform
canvas = Slider(224, range=200..300)
center_pt = Point(<point referenced from the Rhino model>)
number = Number(-1)
multiplication = Multiplication(A=canvas, B=number)
python = PythonScript(x=canvas)  # -> out, a
# ---------- python: Python ----------
__author__ = "leondo"

import rhinoscriptsyntax as rs


from random import randint
print(randint(20,x))
# ---------- end python ----------
python_2 = PythonScript(x=canvas)  # -> out, a
# ---------- python_2: Python ----------
__author__ = "leondo"

import rhinoscriptsyntax as rs


from random import randint
print(randint(-x,-20))
# ---------- end python_2 ----------
python_3 = PythonScript(x=canvas)  # -> out, a; same code as python
python_4 = PythonScript(x=canvas)  # -> out, a; same code as python_2
max_height = Slider(100, range=50..100)
Y = UnitY(Factor=canvas)
move = Move(Geometry=center_pt, Motion=Y)  # -> Geometry, Transform
X = UnitX(Factor=multiplication)
move_2 = Move(Geometry=center_pt, Motion=X)  # -> Geometry, Transform
X_2 = UnitX(Factor=canvas)
move_3 = Move(Geometry=center_pt, Motion=X_2)  # -> Geometry, Transform
Y_2 = UnitY(Factor=multiplication)
move_4 = Move(Geometry=center_pt, Motion=Y_2)  # -> Geometry, Transform
panel = Panel(python.out)
panel_2 = Panel(python_2.out)
panel_3 = Panel(python_3.out)
panel_4 = Panel(python_4.out)
west = Point(move_2.Geometry)
north = Point(move.Geometry)
east = Point(move_3.Geometry)
south = Point(move_4.Geometry)
Y_3 = UnitY(Factor=panel_4)
move_5 = Move(Geometry=center_pt, Motion=Y_3)  # -> Geometry, Transform
Y_4 = UnitY(Factor=panel_3)
move_6 = Move(Geometry=center_pt, Motion=Y_4)  # -> Geometry, Transform
X_3 = UnitX(Factor=panel_2)
move_7 = Move(Geometry=center_pt, Motion=X_3)  # -> Geometry, Transform
X_4 = UnitX(Factor=panel)
move_8 = Move(Geometry=center_pt, Motion=X_4)  # -> Geometry, Transform
python_5 = PythonScript(x=canvas, y=max_height)  # -> out, a
# ---------- python_5: Python ----------
__author__ = "leondo"

import rhinoscriptsyntax as rs


from random import randint
print(randint(10,y))
# ---------- end python_5 ----------
python_6 = PythonScript(x=canvas, y=max_height)  # -> out, a; same code as python_5
python_7 = PythonScript(x=canvas, y=max_height)  # -> out, a; same code as python_5
python_8 = PythonScript(x=canvas, y=max_height)  # -> out, a; same code as python_5
panel_5 = Panel(python_5.out)
panel_6 = Panel(python_6.out)
panel_7 = Panel(python_7.out)
panel_8 = Panel(python_8.out)
Z = UnitZ(Factor=panel_5)
move_9 = Move(Geometry=move_8.Geometry, Motion=Z)  # -> Geometry, Transform
Z_2 = UnitZ(Factor=panel_6)
move_10 = Move(Geometry=move_7.Geometry, Motion=Z_2)  # -> Geometry, Transform
Z_3 = UnitZ(Factor=panel_7)
move_11 = Move(Geometry=move_6.Geometry, Motion=Z_3)  # -> Geometry, Transform
Z_4 = UnitZ(Factor=panel_8)
move_12 = Move(Geometry=move_5.Geometry, Motion=Z_4)  # -> Geometry, Transform
east_2 = Point(flatten(move_9.Geometry))
north_2 = Point(flatten(move_11.Geometry))
west_2 = Point(flatten(move_10.Geometry))
south_2 = Point(flatten(move_12.Geometry))
intcrv = Interpolate(Vertices=[north, north_2, center_pt, south_2, south], Degree=3, Periodic=False, KnotStyle=1)  # -> Curve, Length, Domain
intcrv_2 = Interpolate(Vertices=[east, east_2, center_pt, west_2, west], Degree=3, Periodic=False, KnotStyle=1)  # -> Curve, Length, Domain
intcrv_t = InterpolateT(Degree=3, TangentStart=Vector(0, 0, 0), TangentEnd=Vector(0, 0, 0), KnotStyle=1)  # -> Curve, Length, Domain
